# Requirement set LinkRequirements (R2024a)

## 1 [Mambo Requirements] References to Mambo Requirements.docx (Container)
Imported from Microsoft Word

### 1.1 [Low Altitude Stability: The dron...]
Low Altitude Stability: The drone needs to maintain a stable hover at a minimum height of 1 meter above the ground.

### 1.2 [Flight Time: The drone should be...]
Flight Time: The drone should be able to fly continuously for at least 10 minutes on a full battery charge.

### 1.3 [Battery Charging Duration: The b...]
Battery Charging Duration: The battery should be fully charged within 30 minutes using the provided charger.

### 1.4 [Payload Capacity: The drone shou...]
Payload Capacity: The drone should carry a load of up to 5 grams without a noticeable drop in performance.

### 1.5 [Speed: The drone should be able ...]
Speed: The drone should be able to fly at a top speed of 18 km/h under normal conditions.

### 1.6 [Wind Stability: The drone should...]
Wind Stability: The drone should remain stable in wind speeds up to 15 km/h.

### 1.7 [GPS Precision: The drone’s GPS s...]
GPS Precision: The drone’s GPS should have a positional accuracy within ±2 meters.

### 1.8 [Camera Quality: The built-in cam...]
Camera Quality: The built-in camera should have a resolution of at least 720p HD.

### 1.9 [Control Distance: The drone shou...]
Control Distance: The drone should maintain a reliable connection with the controller up to 100 meters.

### 1.10 [Weight: The drone should not exc...]
Weight: The drone should not exceed a takeoff weight of 63 grams, including the battery and any attachments.

### 1.11 [Stability: The drone should main...]
Stability: The drone should maintain a level flight with pitch and roll deviations not exceeding ±5 degrees.

### 1.12 [Hover Precision: The drone shoul...]
Hover Precision: The drone should hover within a 0.5-meter radius from a fixed point without manual control.

### 1.13 [Temperature Range: The drone sho...]
Temperature Range: The drone should operate reliably within temperatures ranging from -10°C to 40°C.

### 1.14 [Auto Return: The drone should au...]
Auto Return: The drone should automatically return to its takeoff point if the signal is lost or the battery is critically low.

### 1.15 [Obstacle Avoidance: The drone sh...]
Obstacle Avoidance: The drone should detect and avoid obstacles within a range of 1 meter.

### 1.16 [Flight Modes: The drone should o...]
Flight Modes: The drone should offer at least three flight modes: beginner, intermediate, and expert, each with varying levels of automated control.

### 1.17 [Battery Indicator: The drone sho...]
Battery Indicator: The drone should have an LED indicator or app notification for battery levels, alerting at 20% remaining.

### 1.18 [FPV Support: The drone should su...]
FPV Support: The drone should support First Person View (FPV) via a compatible smartphone app, with a latency of less than 200ms.

### 1.19 [Firmware Updates: The drone shou...]
Firmware Updates: The drone should support firmware updates via USB or Wi-Fi to ensure access to the latest features and fixes.